# Grasshopper definition testMesh.gh (Grasshopper 0.9.76)
# plug-ins: Python Interpreter

mesh_uv = MeshSurface(Surface=[<geometry referenced from the Rhino model> x2], UCount=40, VCount=40, Overhang=True, Equalize=False)
mjoin = MeshJoin(Meshes=mesh_uv)
unweld = UnweldMesh(Mesh=mjoin, Angle=1.570796327)
crv = Curve([<curve referenced from the Rhino model> x2])
weld = WeldMesh(Mesh=unweld, Angle=3.141592654)
topoly = CurveToPolyline(Curve=crv, ToleranceDistance=0.05, ToleranceAngle=0)  # -> Polyline, Segments
tri = Triangulate(Mesh=weld)  # -> Mesh, Count
num = Number(1)
num_2 = Number(1)
num_3 = Number(2)
mesh = Mesh(tri.Mesh)
python = PythonScript(M=mesh, T=num, P=topoly.Polyline, R=[num_2, num_3], fn="meshTest", G=Slider(1, range=0..10), output=Toggle(False))  # -> out, a; inputs M: list of Mesh, T: list, P: list of Polyline, R: list, output: Boolean
# ---------- python: Python ----------
import rhinoscriptsyntax as rs
import Rhino.Geometry as rg
filename="c:/out/"+fn+".txt"
if(output):
    file=open(filename,'w')
    file.write('G'+' , '+ str(G)+'\n')
    for (m,t) in zip(M,T):
        file.write('S'+' , '+str(m.Vertices.Count)+' , '+str(m.Faces.Count)+'\n')
        file.write('T'+' , '+str(t)+'\n')
        for v in m.Vertices:
            file.write('V'+' , '+str(v.X)+' , '+str(v.Y)+' , '+str(v.Z)+'\n')
        for f in m.Faces:
            file.write('F'+' , '+str(f.A)+' , '+str(f.B)+' , '+str(f.C)+'\n')
    for (p,r) in zip(P,R):
        file.write('P'+' , ' +str(len(p))+'\n')
        file.write('R , '+str(r)+'\n')
        for s in p:
            file.write('C , '+str(s.X)+' , '+str(s.Y)+' , '+str(s.Z)+"\n")
    file.close()
    print "Finished!"
# ---------- end python ----------
